# Dynamo graph SearchSets_form_ Revit_To_Navis.dyn (Dynamo 1.3.4.6666)

# group: КЛЮЧЕВЫЕ МОМЕНТЫ РАБОТЫ 1
# note: КОНСОЛИДАЦИЯ И СЛОЖНЫЕ ОБРАБОТКИ

# group: ИСПОЛНИТЕЛЬНЫЕ НОДЫ (фильтрование, подбор, списки и т.д.)
# note: ИСПОЛНИТЕЛЬНЫЕ НОДЫ

# group: ЗАПАСНЫЕ ВАРИАНТЫ, ДОПОЛНИТЕЛЬНЫЕ ОПЦИИ
# note: ЗАПАСНЫЕ
# note: ДОПОЛНИТЕЛЬНЫЕ. Градации серово по важности, темнее - важнее

# group: КЛЮЧЕВЫЕ МОМЕНТЫ РАБОТЫ 2
# note: УСЛОЖНЕННЫЕ КОНСТРУКЦИИ
# note: УСЛОЖНЕНЫЕ КОНСТРУКЦИИ

# group: Python ноды
# note: Python

# group: ЭЛЕМЕНТЫ УПРАВЛЕНИЯ 2 УРОВЕНЬ
# note: ЭЛЕМЕНТЫ УПРАВЛЕНИЯ
# note: ПЕРЕМЕННЫЕ ЗНАЧЕНИЯ

# group: Запуск питона из внешнего файла
# note: Py - files

# group: ЭЛЕМЕНТЫ УПРАВЛЕНИЯ
# note: ПЕРЕМЕННЫЕ ЗНАЧЕНИЯ
# note: ЭЛЕМЕНТЫ УПРАВЛЕНИЯ

# group: ПОЛУЧАЕМ ДАННЫЕ
# note: ПОЛУЧАЕМ ДАННЫЕ ИЗ РЕВИТ и других источников

# group: ПРОВЕРОЧНЫЕ НОДЫ
# note: ПРОВЕРОЧНЫЕ НОДЫ

# group: ПЕРЕДАЁМ ИНФОРМАЦИЮ
# note: ПЕРЕДАЁМ ИНФОРМАЦИЮ В РЕВИТ
# note: ПЕРЕДАЁМ ИНФОРМАЦИЮ ЕЩЁ КУДА-ТО

# group: ПРИМЕЧАНИЯ ПО ЦВЕТОВОЙ ГРУППИРОВКЕ
# note: GUIDELINES

save_path_and_filename = StringInput("C:\test\xml\К3_Планы.xml")
список_категорий = StringInput("Части, Стены, Перекрытия, Несущие колонны, Каркас несущий")
save_path_and_filename_2 = CodeBlock(cats=список_категорий) { "d:\\data\\AU\\"+cats+".xml"; }
путь_к_файлу_python = Filename(".\SearchSets_generation.py")
find_file_and_import_it = Python(IN[0]=путь_к_файлу_python)
# ---------- find_file_and_import_it.python (11 lines) ----------
import sys
sys.path.append('C:\Program Files (x86)\IronPython 2.7\Lib')
import codecs

try:
	filePath = IN[0]
	with codecs.open(filePath, 'rb', "utf-8") as inf:
		lines = inf.readlines()
	OUT = ''.join(lines)
except:
	OUT = "No file"
# ----------------------------------------
python_script_собираем_элементы = Python(IN[0]=список_категорий)  # "Python Script - Собираем элементы по категориям"
# ---------- python_script_собираем_элементы.python (44 lines) ----------
import clr
clr.AddReference("RevitServices")
import RevitServices
from RevitServices.Persistence import DocumentManager

clr.AddReference('RevitAPI')
from Autodesk.Revit.DB import *

doc = DocumentManager.Instance.CurrentDBDocument
uiapp = DocumentManager.Instance.CurrentUIApplication
uidoc = DocumentManager.Instance.CurrentUIDocument
app = uiapp.Application
cats = doc.Settings.Categories

def fcollector_by_cat_to_id(doc,c_id):
	return FilteredElementCollector(doc).OfCategoryId(c_id).WhereElementIsNotElementType().ToElements()
	
#cats = doc.Settings.Categories
#cat_except = "Материалы,Виды,Сведения о проекте,Листы"

#cats2 = [cat for cat in cats if cat.Name in cats]
#cats_id = [i.Id for i in cats2]

#new_elements_by_cats = {c_id.IntegerValue:fcollector_by_cat_to_id(doc_new,c_id) for c_id in cats_id if len(fcollector_by_cat_to_id(doc_new,c_id)) != 0}	


cats = doc.Settings.Categories
collector = FilteredElementCollector(doc)
#elements = collector.OwnedByView(uidoc.ActiveView.Id).ToElements()

#elements = UnwrapElement(IN[0])
cats_string = UnwrapElement(IN[0])

cats_id_name = [(cat.Id,cat.Name) for cat in cats if cat.Name in cats_string]
#cats_name = [cat.Name for cat in cats if cat.Name in cats_string]

parts = []
elements = []

[parts.append(fcollector_by_cat_to_id(doc,id_name[0])) if id_name[1] == "Части" else elements.append(fcollector_by_cat_to_id(doc,id_name[0])) for id_name in cats_id_name]
#filtred_cats = [fe.get_Parameter(BuiltInParameter.ELEM_CATEGORY_PARAM).AsValueString() if not fe.get_Parameter(BuiltInParameter.DPART_ORIGINAL_CATEGORY) else fe.get_Parameter(BuiltInParameter.DPART_ORIGINAL_CATEGORY).AsString() for fe in filtred_elements ]

#OUT = [e for e in elements if e.get_Parameter(BuiltInParameter.ELEM_CATEGORY_PARAM).AsValueString() in cats]
OUT = parts,elements#filtred_elements,cats_name
# ----------------------------------------
flatten = Flatten(python_script_собираем_элементы@L3)
code_block = CodeBlock(parts=flatten, elements=flatten) { parts[0]; elements[1]; }
общая_папка___folder_1 = StringInput("К3 Ведомость Сводник")

# group: Сложность при создании поисковых наборов по частям, необходимы свои методы получения данных
code_block_2 = CodeBlock { "Исходная категория"; }
getParameterValueByName = Element.GetParameterValueByName(element=code_block.out0, parameterName=code_block_2)
getCategory = Element.GetCategory(code_block.out1)
name = Category.Name(getCategory)
create = List.Create(getParameterValueByName, name)
параметр_заполняется_в_python = CodeBlock { ""; }
code_block_3 = CodeBlock { "Исходный тип"; }
getParameterValueByName_2 = Element.GetParameterValueByName(element=code_block.out0, parameterName=code_block_3)
type = Archilab.Grimshaw.Elements.Element.Type(code_block.out1)
code_block_4 = CodeBlock { "Имя типа"; }
getParameterValueByName_3 = Element.GetParameterValueByName(element=type, parameterName=code_block_4)
create_2 = List.Create(getParameterValueByName_2, getParameterValueByName_3)
параметры_condition_0_1_2 = List.Create(параметр_заполняется_в_python, create_2, create)

flatten_2 = Flatten(create)
uniqueItems = List.UniqueItems(flatten_2)
под_папки___folders_2 = CodeBlock(__FOLDERs_2__=uniqueItems) { __FOLDERs_2__; }
папки = List.Create(общая_папка___folder_1, под_папки___folders_2)
start_FOLDER = StringInput("""<?xml version="1.0" encoding="UTF-8" ?>

<exchange xmlns:xsi="http://www.w3.org/2001/XMLSchema-instance" xsi:noNamespaceSchemaLocation="http://download.autodesk.com/us/navisworks/schemas/nw-exchange-12.0.xsd" units="ft">
  <selectionsets>
    <viewfolder name="__FOLDER_1__" guid="__FOLDER_1_GUID__">
      __FOLDER_2_SET__
    </viewfolder>
  </selectionsets>
</exchange>
""")
FOLDER2 = StringInput("""<viewfolder name="__FOLDER_2__" guid="__FOLDER_2_GUID__">
  __SELECTION_SETS__
</viewfolder>""")
SELECTION_SET = StringInput("""<selectionset name="__SELECTIONSET_NAME__" guid="__SELECTIONSET_GUID__">
      <findspec mode="all" disjoint="0">
        <conditions>
          __CONDITIONS__
        </conditions>
        <locator>/</locator>
      </findspec>
    </selectionset>""")
create_XML_BASE = List.Create(start_FOLDER, FOLDER2, SELECTION_SET)  # "List.Create_XML_BASE"
condition_0 = StringInput("""          <condition test="contains" flags="10">
            <property>
              <name internal="LcOaNodeSourceFile">Файл источника</name>
            </property>
            <value>
              <data type="wstring">__FILE_TITLE__</data>
            </value>
          </condition>""")
condition_1 = StringInput("""          <condition test="equals" flags="10">
            <category>
              <name internal="LcRevitData_Element">Объект</name>
            </category>
            <property>
              <name internal="LcRevitPropertyElementType">Тип</name>
            </property>
            <value>
              <data type="wstring">__TYPE_NAME__</data>
            </value>
          </condition>""")
condition_2 = StringInput("""          <condition test="equals" flags="10">
            <category>
              <name internal="LcRevitData_Element">Объект</name>
            </category>
            <property>
              <name internal="LcRevitPropertyElementCategory">Категория</name>
            </property>
            <value>
              <data type="wstring">__CATEGORY__</data>
            </value>
          </condition>""")
create_CONDITIONS = List.Create(condition_0, condition_1, condition_2)  # "List.Create_CONDITIONS"
список_conditions = CodeBlock { {"__FILE_TITLE__","__TYPE_NAME__","__CATEGORY__"}; }
python_script_from_string = PythonStringNode(script=find_file_and_import_it, IN[0]=code_block.out0, IN[1]=папки, IN[2]=create_XML_BASE, IN[3]=create_CONDITIONS, IN[4]=параметры_condition_0_1_2, IN[5]=список_conditions)
writeToFile = CSV.WriteToFile(save_path_and_filename_2, python_script_from_string)
список_категорий_2 = StringInput("Части, Окна, Панели витража, Несущие колонны, Ограждение")
список_категорий_3 = StringInput("Стены")
boolean = BoolSelector(true)  # frozen
code_block_5 = CodeBlock { 1; 2; }
if_ = Python(IN[0]=boolean, IN[1]=code_block_5.out0, IN[2]=code_block_5.out1)
# ---------- if_.python (12 lines) ----------
import clr
boolean = IN[0]
true = UnwrapElement(IN[1])
false = UnwrapElement(IN[2])

if boolean:
	out = true
else:
	out = false

#Назначьте вывод переменной OUT.
OUT = out
# ----------------------------------------
geometry = Element.Geometry()  # unwired: arg0
# note: ВСЁ ОСТАЛЬНОЕ
getParameterValueByName_4 = Element.GetParameterValueByName()  # unwired: element, parameterName
members = Python()  # "Object.Members"; frozen; unwired: IN[0]
# ---------- members.python (14 lines) ----------
import clr

items = IN[0]
elementlist = list()

try:
	clr.AddReference('RevitAPI')
	from Autodesk.Revit.DB import *
	for item in items:
		elementlist.append(dir(UnwrapElement(item)))
except:
	for item in items:
		elementlist.append(dir(item))
OUT = elementlist
# ----------------------------------------
filteredElementCollector = Python()  # frozen; unwired: IN[0]
# ---------- filteredElementCollector.python (29 lines) ----------
if IN[1]:
	import clr
	
	# Import DocumentManager and TransactionManager
	clr.AddReference("RevitServices")
	import RevitServices
	from RevitServices.Persistence import DocumentManager
	
	
	# Import RevitAPI
	clr.AddReference("RevitAPI")
	import Autodesk
	from Autodesk.Revit.DB import *
	
	doc = DocumentManager.Instance.CurrentDBDocument
	uiapp = DocumentManager.Instance.CurrentUIApplication
	app = uiapp.Application
	
	from System.Collections.Generic import *
	
	
	#The inputs to this node will be stored as a list in the IN variable.
	dataEnteringNode = IN
	collector = FilteredElementCollector(doc)
	elements = collector.OfCategory(BuiltInCategory.OST_Views).ToElements()
	
	OUT = sheetInstances
else:
	OUT = "скрипт не выполнен"
# ----------------------------------------
shablon_python_shablon = Python()  # frozen; unwired: IN[0]
# ---------- shablon_python_shablon.python (77 lines) ----------
# -*- coding: utf-8 -*- 
#-----------------------Импоорт библиотек----------------------
import clr
clr.AddReference('RevitAPI')
import Autodesk
from Autodesk.Revit.DB import *

clr.AddReference("RevitNodes") 
import Revit
from Revit.Elements import *

clr.ImportExtensions(Revit.Elements) #ToDSType не работает без
clr.ImportExtensions(Revit.GeometryConversion) #ToXyz не работает без

clr.AddReference("RevitServices")
import RevitServices
from RevitServices.Persistence import DocumentManager
from RevitServices.Transactions import TransactionManager

clr.AddReference('ProtoGeometry')
from Autodesk.DesignScript.Geometry import *

#-----------------------ИМПОРТ БИБЛИОТЕК----------------------
"""-"""
#-----------------------ФУНКЦИИ----------------------

def __x__(x):
	x="x"
	return x
	
#-----------------------ФУНКЦИИ----------------------
"""-"""
#-----------------------АПИ ПАРАМЕТРЫ----------------------

doc = DocumentManager.Instance.CurrentDBDocument
#link_doc = UnwrapElement(IN[1])
#uiapp = DocumentManager.Instance.CurrentUIApplication
#app = uiapp.Application
#version = app.VersionNumber
#options = Autodesk.Revit.DB.SpatialElementBoundaryOptions()
calculator = SpatialElementGeometryCalculator(doc)

g_id_list = []
g_id_list.append(ElementId(group))

bxList = List[ElementId](g_id_list) #АЙ ЛИСТ КОЛЕКТИОН
move = Transform.CreateTranslation(-wall.Orientation*2) #смещение
cl.CreateTransformed(move)

#-----------------------АПИ ПАРАМЕТРЫ----------------------
"""-"""
#-----------------------РАБОЧИЕ ПАРАМЕТРЫ----------------------

rooms = UnwrapElement(IN[0])

#-----------------------РАБОЧИЕ ПАРАМЕТРЫ----------------------	
"""-"""
#-----------------------ТЕСТОВЫЕ ПАРАМЕТРЫ----------------------

test = []

#-----------------------ТЕСТОВЫЕ ПАРАМЕТРЫ----------------------
"""-"""
#-----------------------НАЧАЛО СКРИПТА----------------------

x = 0
if rooms == None:
	rooms = [0,0]

for room in rooms:
	x=__x__(x)+__x__(x)
#TransactionManager.Instance.EnsureInTransaction(doc)
#TransactionManager.Instance.TransactionTaskDone()
#TransactionManager.Instance.ForceCloseTransaction()
#-----------------------КОНЕЦ СКРИПТА----------------------

OUT = x
# ----------------------------------------

# group: Get Revit Selection:
forceChildrensEval = ForceChildrensEval()  # frozen; unwired: arg0
pys_get_revit_selection = Python(IN[0]=forceChildrensEval)
# ---------- pys_get_revit_selection.python (22 lines) ----------
import clr
clr.AddReference('RevitServices')
clr.AddReference('RevitAPI')
from Autodesk.Revit.DB import *
import RevitServices
from RevitServices.Persistence import DocumentManager
from Autodesk.Revit.ApplicationServices import Application

reset = IN[0]

doc = DocumentManager.Instance.CurrentDBDocument
uidoc = DocumentManager.Instance.CurrentUIApplication.ActiveUIDocument
ids = uidoc.Selection.GetElementIds()

idd = [str(i) for i in ids]

if isinstance(idd, list) == True:
	elems = [doc.GetElement(ElementId(int(i))) for i in idd]
else:
	elems = doc.GetElement(ElementId(int(idd)))

OUT = elems
# ----------------------------------------

# group: Parameters name from language
parameters_name_from_language = Python()  # frozen
# ---------- parameters_name_from_language.python (18 lines) ----------
import clr
clr.AddReference('RevitServices')
import RevitServices
from RevitServices.Persistence import DocumentManager

uiapp = DocumentManager.Instance.CurrentUIApplication
app = uiapp.Application
lng = app.Language
rus = ["Тип","Имя семейства","Имя типа"]
enu = ["Type","Family name","Type name"]
out = []
if str(lng) == "Russian":
	out = rus
else:
	out = enu
#English_USA
#Russian
OUT = out
# ----------------------------------------

# group: элементы внутри групп
members_2 = Python()  # "Group.Members"; frozen; unwired: IN[0]
# ---------- members_2.python (19 lines) ----------
import clr
clr.AddReference('RevitAPI')
from Autodesk.Revit.DB import *

clr.AddReference("RevitNodes")
import Revit
clr.ImportExtensions(Revit.Elements)

groups = UnwrapElement(IN[0])
elementlist = list()
for item in groups:
	try:
		memberlist = list()
		for member in item.GetMemberIds():
			memberlist.append(item.Document.GetElement(member))
		elementlist.append(memberlist)
	except:
		elementlist.append(list())
OUT = elementlist
# ----------------------------------------

путь_к_файлу_python_2 = Filename(".\N.Отделка помещений_сбор элементов вокруг_1.7.py")  # frozen
forceChildrensEval_2 = ForceChildrensEval(путь_к_файлу_python_2)
find_file_and_import_it_2 = Python(IN[0]=forceChildrensEval_2)  # same code as find_file_and_import_it
python_script_from_string_2 = PythonStringNode(script=find_file_and_import_it_2)  # unwired: IN[0]
categories = Categories()  # frozen
all_elements_of_category = ElementsOfCategory(categories)
regenerate = Python()  # frozen; unwired: IN[0]
# ---------- regenerate.python (26 lines) ----------
import clr

# Import DocumentManager and TransactionManager
clr.AddReference("RevitServices")
import RevitServices
from RevitServices.Persistence import DocumentManager


# Import RevitAPI
clr.AddReference("RevitAPI")
import Autodesk
from Autodesk.Revit.DB import *

doc = DocumentManager.Instance.CurrentDBDocument


#The inputs to this node will be stored as a list in the IN variable.
list = IN[0]


if list:
	doc.Regenerate()
	out = "Regeneration complete"
else:
	out = "fail"
OUT = out
# ----------------------------------------
forceChildrensEval_3 = ForceChildrensEval()  # unwired: arg0
load_dll = Python(IN[0]=forceChildrensEval_3)
# ---------- load_dll.python (44 lines) ----------
# -*- coding: utf-8 -*- 
#-----------------------Импоорт библиотек----------------------
import clr
clr.AddReference('RevitAPI')
import Autodesk
from Autodesk.Revit.DB import *
from Autodesk.Revit.DB.Analysis import *
from Autodesk.Revit.DB.Events import *
from Autodesk.Revit.Creation import *


clr.AddReference("RevitNodes") 
import Revit
from Revit.Elements import *

clr.ImportExtensions(Revit.Elements) #ToDSType не работает без
clr.ImportExtensions(Revit.GeometryConversion) #ToXyz не работает без

clr.AddReference("RevitServices")
import RevitServices
from RevitServices.Persistence import DocumentManager
from RevitServices.Transactions import TransactionManager

clr.AddReference('ProtoGeometry')
from Autodesk.DesignScript.Geometry import *

import System
from System import Type,Byte,DateTime,Text,IO
clr.AddReference('System')
from System.Collections.Generic import List

clr.AddReferenceToFileAndPath(r"C:\VS\source\repos\SheduleToExcelDll\SheduleToExcelDll\bin\Debug\SheduleToExcelDll.dll")
import SheduleToExcelDll
from SheduleToExcelDll import Class1

ids = UnwrapElement(IN[0])

test = SheduleToExcelDll.Class1
test2 = 0

#test2 = test.FilterSelect()
#test.ExportAllSchedules()

OUT = test2, 0, Class1.test
# ----------------------------------------
select_model_elements = DSModelElementsSelection()
id = Element.Id(select_model_elements)
delete = Python()  # "Elements.Delete"; unwired: IN[0]
# ---------- delete.python (44 lines) ----------
import clr
#clr.AddReference('ProtoGeometry')
#from Autodesk.DesignScript.Geometry import *
# Import ToDSType(bool) extension method
#clr.AddReference("RevitNodes")
#import Revit
#clr.ImportExtensions(Revit.Elements)
# Import geometry conversion extension methods
#clr.ImportExtensions(Revit.GeometryConversion)
# Import DocumentManager and TransactionManager
clr.AddReference("RevitServices")
import RevitServices
from RevitServices.Persistence import DocumentManager
from RevitServices.Transactions import TransactionManager
#from System.Collections.Generic import *
# Import RevitAPI
clr.AddReference("RevitAPI")
import Autodesk
from Autodesk.Revit.DB import Document

doc = DocumentManager.Instance.CurrentDBDocument
uiapp = DocumentManager.Instance.CurrentUIApplication
app = uiapp.Application

elt = []
for i in IN[0]:
	elt.append(UnwrapElement(i).Id)

# Start Transaction
TransactionManager.Instance.EnsureInTransaction(doc)


cantdelete=[]
for item in elt:
	try:
		doc.Delete(item)
	except:
		cantdelete.append(item)
		

# End Transaction
TransactionManager.Instance.TransactionTaskDone()
doc.Regenerate()
OUT=cantdelete
# ----------------------------------------
